# Grasshopper definition simple_example.gh (Grasshopper 1.0.7)

python = GhPythonScript()  # -> out, file
# ---------- python: Python ----------
import rhinoscriptsyntax as rs

filter = "GCode (*.gcode)|*.gcode|All Files (*.*)|*.*||"
file = rs.SaveFileName("", filter)
# ---------- end python ----------
python_2 = GhPythonScript(file=python.file)  # -> out, lines, extrusion, turtle
# ---------- python_2: Python ----------
# code required so that library reloads appropriately
# must be above other import statements
import sys
to_delete = list()
for module in sys.modules:
   if "extruder_turtle" in module:
      to_delete.append(module)  

for module in to_delete:
    sys.modules.pop(module)
    
import rhinoscriptsyntax as rs
import numbers
import extruder_turtle
from extruder_turtle import *
import math
import random

reload(extruder_turtle)

t = ExtruderTurtle()
t.use_degrees = True

## Set up the turtle
t.setup(x=100, y=100, z=0, filename=file)



#####################################################


lines = []
for l in t.line_segs:
    lines.append(rs.AddLine(l[0], l[1]))

extrusion = []
i = 0
for e in t.extrusion_history:
    if (i>0):
        distance = rs.CurveLength(lines[i])
        density = e/distance
        extrusion.append(extrude_width)
    i=i+1

t.finish()
# ---------- end python_2 ----------
line = Line(python_2.lines)
srf = Surface(python_2.turtle)
pipe = Pipe(Curve=line, Radius=python_2.extrusion, Caps=0)
